# Dynamo custom node Curve.ReverseFixed.dyf (Dynamo 2.0.1.5354)
# category: RAV.Geometry
# Fixes Reverse in some cases where it wouldn't wokr more than once.

nurbsCurve = Input(nurbsCurve: Autodesk.DesignScript.Geometry.NurbsCurve)
controlPoints = NurbsCurve.ControlPoints(nurbsCurve=nurbsCurve)
reverse = List.Reverse(list=controlPoints)
count = List.Count(list=reverse)
code_block = CodeBlock(x=count) { x - 1; }
byControlPoints = NurbsCurve.ByControlPoints(points=reverse, degree=code_block)
NurbsCurve = Output(byControlPoints)
