# Dynamo custom node Curves.Align.dyf (Dynamo 2.0.1.6255)
# category: RAV.Geometry
# Align a list of Curves in regards to a point.

switch = Input(switch: bool = false)  # Reverse Curves?
curves = Input(curves: Autodesk.DesignScript.Geometry.Curve[])  # List of curves
startPoint = Curve.StartPoint(curve=curves)
geo = Input(geo: Autodesk.DesignScript.Geometry.Geometry[][] = Autodesk.DesignScript.Geometry.Point.ByCoordinates(0, 0, -300))  # Orientation Geometry
distanceTo = Geometry.DistanceTo(geometry=startPoint, other=geo, lacing=CrossProduct)
flatten = List.Flatten(list=distanceTo)
endPoint = Curve.EndPoint(curve=curves)
distanceTo_2 = Geometry.DistanceTo(geometry=endPoint, other=geo, lacing=CrossProduct)
flatten_2 = List.Flatten(list=distanceTo_2)
gt = flatten > flatten_2
identity = Object.Identity(obj=curves)
reverseFixed = Custom[Curve.ReverseFixed](nurbsCurve=curves)  # Fixes Reverse in some cases where it wouldn't wokr more than once.
if_ = If(test=gt, true=identity, false=reverseFixed)
reverseFixed_2 = Custom[Curve.ReverseFixed](nurbsCurve=if_)
if_2 = If(test=switch, true=reverseFixed_2, false=if_)
AlignedCurves = Output(if_2)  # An aligned list of curves
