# Dynamo custom node Curves.SortByDistance.dyf (Dynamo 2.0.1.6255)
# category: RAV.Geometry
# Sorts a List of Curves based on the Distance to another object.

curves = Input(curves: Autodesk.DesignScript.Geometry.Curve[])  # List of curves
code_block = CodeBlock { 0.5; }
pointAtParameter = Curve.PointAtParameter(param=code_block)  # unwired: curve
Z = Point.Z()  # unwired: point
function_compose = ComposeFunctions(func0=pointAtParameter, func1=Z)
sortByFunction = List.SortByFunction(list=curves@L2, func=function_compose)
flatten = List.Flatten(list=sortByFunction)
SortedCurves = Output(flatten)  # An sorted list of curves
