# Dynamo graph diamondGrill_by_uvGrid.DYN "diamondGrill_by_uvGrid.DYN" (Dynamo 2.0.1.6255)

select_from_alias = SelectNode()
number_slider = DoubleSlider(26.9, range=0..100 step 0.1)
number_slider_2 = DoubleSlider(3.6, range=0..100 step 0.1)
code_block = CodeBlock(fillet1=number_slider, fillet2=number_slider_2)  # unwired: list1, list2
# ---------- code_block.designscript (61 lines) ----------
list1;
list2;

curveList = [];
curveList2 = [];

fillet1;
fillet2;
c = List.Count(list1)-1;

[Imperative]
{
	for (i in 0..c-1)
	{
		for (j in 0..List.Count(list1[i])-1)
		{
			a = list2[i][j];
			b = list1[i][j];
			c = list2[i][j+1];

			d = list2[i][j];
			e = list1[i+1][j];
			f = list2[i][j+1];

			pc0 = PolyCurve.ByPoints([a,b,c]);
			pc1 = PolyCurve.ByPoints([d,e,f]);

			pc0 = PolyCurve.Fillet(pc0, fillet1, false);
			pc1 = PolyCurve.Fillet(pc1, fillet1, false);

			pc = PolyCurve.ByJoinedCurves([pc0, pc1]);
			pc = PolyCurve.Fillet(pc, fillet2, false);

			curveList[i][j] = pc;
		}

		for (k in 0..List.Count(list1[i])-2)
		{
			a = list1[i+1][k];
			b = list2[i][k+1];
			c = list1[i+1][k+1];

			d = list1[i+1][k];
			e = list2[i+1][k+1];
			f = list1[i+1][k+1];

			pc0 = PolyCurve.ByPoints([a,b,c]);
			pc1 = PolyCurve.ByPoints([d,e,f]);

			pc0 = PolyCurve.Fillet(pc0, fillet1, false);
			pc1 = PolyCurve.Fillet(pc1, fillet1, false);

			pc = PolyCurve.ByJoinedCurves([pc0, pc1]);
			pc = PolyCurve.Fillet(pc, fillet2, false);

			curveList2[i][k] = pc;
		}
	}

	return [curveList,curveList2];
};
# ----------------------------------------
code_block_2 = CodeBlock { false; }
clean = List.Clean(list=code_block.out7, preserveIndices=code_block_2)  # frozen
number_slider_3 = DoubleSlider(-2, range=-6..0 step 1)
code_block_3 = CodeBlock { false; }
offset = PolyCurve.Offset(polyCurve=clean, signedDistance=number_slider_3, extendCircular=code_block_3)
clean_2 = List.Clean(list=offset)
code_block_4 = CodeBlock { -200; }
extrudeAsSolid = Curve.ExtrudeAsSolid(curve=clean_2, distance=code_block_4)
flatten = List.Flatten(list=extrudeAsSolid)
clean_3 = List.Clean(list=flatten)
byUnion = Solid.ByUnion(solids=clean_3)
subtractFrom = Surface.SubtractFrom(surface=select_from_alias, trimmingEntity=byUnion)
bake_to_alias = BakeNode(subtractFrom)
byJoinedSurfaces = PolySurface.ByJoinedSurfaces(surfaces=select_from_alias)  # frozen
perimeterCurves = Surface.PerimeterCurves(surface=byJoinedSurfaces)
code_block_5 = CodeBlock { 0.05; }
byJoinedCurves = PolyCurve.ByJoinedCurves(curves=perimeterCurves, joinTolerance=code_block_5)
code_block_6 = CodeBlock { Vector.ByCoordinates(30,0,0); }
extrudeAsSolid_2 = Curve.ExtrudeAsSolid(curve=byJoinedCurves, direction=code_block_6)
watch = Watch(offset)
XAxis = Vector.XAxis()
projectInputOnto = Surface.ProjectInputOnto(surface=select_from_alias, geometryToProject=watch, projectionDirection=XAxis, lacing=CrossProduct)
code_block_7 = CodeBlock { 5; }
translate = Geometry.Translate(geometry=select_from_alias, xTranslation=code_block_7)
number_slider_4 = DoubleSlider(1, range=0..3 step 1)
code_block_8 = CodeBlock(y=number_slider_3, x=number_slider_4) { y-x; }
offset_2 = PolyCurve.Offset(polyCurve=clean, signedDistance=code_block_8, extendCircular=code_block_3)
projectInputOnto_2 = Surface.ProjectInputOnto(surface=translate, geometryToProject=offset_2, projectionDirection=XAxis, lacing=CrossProduct)
code_block_9 = CodeBlock(list1=projectInputOnto, list2=projectInputOnto_2)
# ---------- code_block_9.designscript (26 lines) ----------
list1;
list2;
listResult = [];

c = List.Count(list1)-1;
t = 0;

[Imperative]
{
	for (i in 0..c)
	{
		for (j in 0..List.Count(list1[i])-1)
		{
			for (k in 0..List.Count(list1[i][j])-1)
			{
				for (l in 0..List.Count(list1[i][j][k])-1)
				{
					listResult[i][j][k][l][0] = PolyCurve.ByJoinedCurves(list1[i][j][k][l]);
					listResult[i][j][k][l][1] = PolyCurve.ByJoinedCurves(list2[i][j][k][l]);
				}

			}
		}
	}
	return listResult;
};
# ----------------------------------------
byLoft = Surface.ByLoft(crossSections=code_block_9.out5)

# group: SOLID BAUEN
select_from_alias_2 = SelectNode()  # frozen
byJoinedSurfaces_2 = PolySurface.ByJoinedSurfaces(surfaces=select_from_alias_2)  # frozen
perimeterCurves_2 = Surface.PerimeterCurves(surface=byJoinedSurfaces_2)
origin = Point.Origin()
integer_slider = IntegerSlider(30, range=-100..30 step 1)
byCoordinates = Point.ByCoordinates(x=integer_slider)
byTwoPoints = Vector.ByTwoPoints(start=origin, end=byCoordinates)
extrude = Curve.Extrude(curve=perimeterCurves_2, direction=byTwoPoints)
byJoinedSurfaces_3 = PolySurface.ByJoinedSurfaces(surfaces=extrude)
translate_2 = Geometry.Translate(geometry=byJoinedSurfaces_2, xTranslation=integer_slider)
list_create = List.Create(item0=byJoinedSurfaces_2, item1=byJoinedSurfaces_3, item2=translate_2)
byJoinedSurfaces_4 = Solid.ByJoinedSurfaces(facesOfSolid=list_create)
bake_to_alias_2 = BakeNode(byJoinedSurfaces_4)  # frozen

file_path = Filename("M:\BASICS\TOOLS\Dynamo\Code\uvGrid.py")
file_from_path = FileObject(path=file_path)
readText = FileSystem.ReadText(file=file_from_path)
watch_2 = Watch(readText)
support_surface = SelectNode()
v_divisions = DoubleSlider(10, range=1..25 step 1)
u_divisions = DoubleSlider(10, range=1..25 step 1)

# group: Grid on Support Surface
code_block_10 = CodeBlock(n=v_divisions) { dist = 0..1..#n; dif = dist[1]; 0-dif..1+dif*(n-1)..#n+n; }
code_block_11 = CodeBlock(n=u_divisions) { dist = 0..1..#n; dif = dist[1]; 0-dif..1+dif..#n+2; }
pointAtParameter = Surface.PointAtParameter(surface=support_surface, u=code_block_10.out2, v=code_block_11.out2, lacing=CrossProduct)  # frozen

python_script_from_string = PythonStringNode(script=readText, IN[0]=pointAtParameter)
watch_3 = Watch(python_script_from_string)
RPW_GetFilepath = Custom[RPW_GetFilepath]()
python_script = Python(IN[0]=RPW_GetFilepath)  # starter script, not edited (OUT = 0)
byLoft_2 = PolySurface.ByLoft()  # unwired: crossSections
list_create_2 = List.Create()  # unwired: item0, item1
transpose = List.Transpose(lists=list_create_2)
select_from_alias_3 = SelectNode()
byJoinedSurfaces_5 = PolySurface.ByJoinedSurfaces(surfaces=select_from_alias_3)
number_slider_5 = DoubleSlider(-3, range=-6..0 step 1)
offset_3 = Curve.Offset(curve=python_script_from_string, distance=number_slider_5)
number_slider_6 = DoubleSlider(0.8, range=0..1 step 0.05)
trimByEndParameter = Curve.TrimByEndParameter(curve=offset_3, endParameter=number_slider_6)
number_slider_7 = DoubleSlider(0.25, range=0..1 step 0.05)
trimByStartParameter = Curve.TrimByStartParameter(curve=trimByEndParameter, startParameter=number_slider_7)
code_block_12 = CodeBlock { 2; }
takeItems = List.TakeItems(list=trimByStartParameter@L2, amount=code_block_12)
firstItem = List.FirstItem(list=takeItems@L2)
lastItem = List.LastItem(list=takeItems@L2)
boolean = BoolSelector(false)
byBlendBetweenCurves = Curve.ByBlendBetweenCurves(curve1=firstItem, curve2=lastItem, endOrStart1=boolean, endOrStart2=boolean)
endPoint = Curve.EndPoint(curve=trimByEndParameter)
code_block_13 = CodeBlock { 2; }
takeEveryNthItem = List.TakeEveryNthItem(list=endPoint@L2, n=code_block_13)
firstItem_2 = List.FirstItem(list=takeEveryNthItem@L2)
lastItem_2 = List.LastItem(list=takeEveryNthItem@L2)
byStartPointEndPoint = Line.ByStartPointEndPoint(startPoint=firstItem_2, endPoint=lastItem_2)
code_block_14 = CodeBlock { -2; }
takeItems_2 = List.TakeItems(list=trimByStartParameter@L2, amount=code_block_14)
firstItem_3 = List.FirstItem(list=takeItems_2@L2)
lastItem_3 = List.LastItem(list=takeItems_2@L2)
boolean_2 = BoolSelector(false)
byBlendBetweenCurves_2 = Curve.ByBlendBetweenCurves(curve1=firstItem_3, curve2=lastItem_3, endOrStart1=boolean_2, endOrStart2=boolean_2)
code_block_15 = CodeBlock { 2; }
code_block_16 = CodeBlock { 1; }
takeEveryNthItem_2 = List.TakeEveryNthItem(list=endPoint@L2, n=code_block_15, offset=code_block_16)
firstItem_4 = List.FirstItem(list=takeEveryNthItem_2@L2)
lastItem_4 = List.LastItem(list=takeEveryNthItem_2@L2)
byStartPointEndPoint_2 = Line.ByStartPointEndPoint(startPoint=firstItem_4, endPoint=lastItem_4)
list_create_3 = List.Create(item0=firstItem, item1=byBlendBetweenCurves, item2=lastItem, item3=byStartPointEndPoint, item4=firstItem_3, item5=byBlendBetweenCurves_2, item6=lastItem_3, item7=byStartPointEndPoint_2)
transpose_2 = List.Transpose(lists=list_create_3)
byJoinedCurves_2 = PolyCurve.ByJoinedCurves(curves=transpose_2)
number_slider_8 = DoubleSlider(0.5, range=0..10 step 1)
number_slider_9 = DoubleSlider(1, range=0..100 step 0.1)
code_block_17 = CodeBlock(x=number_slider_8, y=number_slider_9) { x+y; }
boolean_3 = BoolSelector(true)
fillet = PolyCurve.Fillet(polyCurve=byJoinedCurves_2, radius=code_block_17, rightSide=boolean_3)
XAxis_2 = Vector.XAxis()
projectInputOnto_3 = Surface.ProjectInputOnto(surface=byJoinedSurfaces_5, geometryToProject=fillet, projectionDirection=XAxis_2)
code_block_18 = CodeBlock { 0.08; }
byJoinedCurves_3 = PolyCurve.ByJoinedCurves(curves=projectInputOnto_3, joinTolerance=code_block_18)
code_block_19 = CodeBlock { 5; }
translate_3 = Geometry.Translate(geometry=byJoinedSurfaces_5, xTranslation=code_block_19)
ꟿ_closedcurve_offset = Custom[ꟿ ClosedCurve.Offset+](curve=fillet, distance=number_slider_9)  # Offsets a curve both ways and correctly differenciates the external and internal offset. If an offset goes beyond the curve's bounds, the result will fail and a null value will be appended instead. Also works for convex curves like arcs.
projectInputOnto_4 = Surface.ProjectInputOnto(surface=translate_3, geometryToProject=ꟿ_closedcurve_offset.internal_offset, projectionDirection=XAxis_2)
byJoinedCurves_4 = PolyCurve.ByJoinedCurves(curves=projectInputOnto_4, joinTolerance=code_block_18)
file_path_2 = Filename("M:\BASICS\TOOLS\Dynamo\Code\uvGrid.py")
file_from_path_2 = FileObject(path=file_path_2)
readText_2 = FileSystem.ReadText(file=file_from_path_2)
watch_4 = Watch(readText_2)
support_surface_2 = SelectNode()
v_divisions_2 = DoubleSlider(8, range=1..25 step 1)
u_divisions_2 = DoubleSlider(10, range=1..25 step 1)

# group: Grid on Support Surface
code_block_20 = CodeBlock(n=v_divisions_2) { dist = 0..1..#n; dif = dist[1]; 0-dif..1+dif*(n-1)..#n+n; }
code_block_21 = CodeBlock(n=u_divisions_2) { dist = 0..1..#n; dif = dist[1]; 0-dif..1+dif..#n+2; }
pointAtParameter_2 = Surface.PointAtParameter(surface=support_surface_2, u=code_block_20.out2, v=code_block_21.out2, lacing=CrossProduct)

python_script_from_string_2 = PythonStringNode(script=readText_2, IN[0]=pointAtParameter_2)
watch_5 = Watch(python_script_from_string_2)
select_from_alias_4 = SelectNode()
byJoinedSurfaces_6 = PolySurface.ByJoinedSurfaces(surfaces=select_from_alias_4)
code_block_22 = CodeBlock { 5; }
translate_4 = Geometry.Translate(geometry=byJoinedSurfaces_6, xTranslation=code_block_22)
number_slider_10 = DoubleSlider(-3, range=-6..0 step 1)
offset_4 = Curve.Offset(curve=python_script_from_string_2, distance=number_slider_10)
number_slider_11 = DoubleSlider(0.75, range=0..1 step 0.05)
trimByEndParameter_2 = Curve.TrimByEndParameter(curve=offset_4, endParameter=number_slider_11)
number_slider_12 = DoubleSlider(0.25, range=0..1 step 0.05)
trimByStartParameter_2 = Curve.TrimByStartParameter(curve=trimByEndParameter_2, startParameter=number_slider_12)
code_block_23 = CodeBlock { 2; }
takeItems_3 = List.TakeItems(list=trimByStartParameter_2@L2, amount=code_block_23)
firstItem_5 = List.FirstItem(list=takeItems_3@L2)
lastItem_5 = List.LastItem(list=takeItems_3@L2)
boolean_4 = BoolSelector(false)
byBlendBetweenCurves_3 = Curve.ByBlendBetweenCurves(curve1=firstItem_5, curve2=lastItem_5, endOrStart1=boolean_4, endOrStart2=boolean_4)
endPoint_2 = Curve.EndPoint(curve=trimByEndParameter_2)
code_block_24 = CodeBlock { 2; }
takeEveryNthItem_3 = List.TakeEveryNthItem(list=endPoint_2@L2, n=code_block_24)
firstItem_6 = List.FirstItem(list=takeEveryNthItem_3@L2)
lastItem_6 = List.LastItem(list=takeEveryNthItem_3@L2)
byStartPointEndPoint_3 = Line.ByStartPointEndPoint(startPoint=firstItem_6, endPoint=lastItem_6)
code_block_25 = CodeBlock { -2; }
takeItems_4 = List.TakeItems(list=trimByStartParameter_2@L2, amount=code_block_25)
firstItem_7 = List.FirstItem(list=takeItems_4@L2)
lastItem_7 = List.LastItem(list=takeItems_4@L2)
boolean_5 = BoolSelector(false)
byBlendBetweenCurves_4 = Curve.ByBlendBetweenCurves(curve1=firstItem_7, curve2=lastItem_7, endOrStart1=boolean_5, endOrStart2=boolean_5)
code_block_26 = CodeBlock { 2; }
code_block_27 = CodeBlock { 1; }
takeEveryNthItem_4 = List.TakeEveryNthItem(list=endPoint_2@L2, n=code_block_26, offset=code_block_27)
firstItem_8 = List.FirstItem(list=takeEveryNthItem_4@L2)
lastItem_8 = List.LastItem(list=takeEveryNthItem_4@L2)
byStartPointEndPoint_4 = Line.ByStartPointEndPoint(startPoint=firstItem_8, endPoint=lastItem_8)
list_create_4 = List.Create(item0=firstItem_5, item1=byBlendBetweenCurves_3, item2=lastItem_5, item3=byStartPointEndPoint_3, item4=firstItem_7, item5=byBlendBetweenCurves_4, item6=lastItem_7, item7=byStartPointEndPoint_4)
transpose_3 = List.Transpose(lists=list_create_4)
byJoinedCurves_5 = PolyCurve.ByJoinedCurves(curves=transpose_3)
code_block_28 = CodeBlock { 500; }
extrudeAsSolid_3 = Curve.ExtrudeAsSolid(curve=byJoinedCurves_5, distance=code_block_28)
flatten_2 = List.Flatten(list=extrudeAsSolid_3)
byUnion_2 = Solid.ByUnion(solids=flatten_2)
select_from_alias_5 = SelectNode()
byJoinedCurves_6 = PolyCurve.ByJoinedCurves(curves=select_from_alias_5)
code_block_29 = CodeBlock { 1000; }
extrudeAsSolid_4 = Curve.ExtrudeAsSolid(curve=byJoinedCurves_6, distance=code_block_29)
select_from_alias_6 = SelectNode()
byJoinedCurves_7 = PolyCurve.ByJoinedCurves(curves=select_from_alias_6)
extrudeAsSolid_5 = Curve.ExtrudeAsSolid(curve=byJoinedCurves_7, distance=code_block_29)
difference = Solid.Difference(solid=extrudeAsSolid_4, other=extrudeAsSolid_5)
difference_2 = Solid.Difference(solid=byUnion_2, other=difference)
subtractFrom_2 = Surface.SubtractFrom(surface=select_from_alias_4, trimmingEntity=difference_2)
flatten_3 = List.Flatten(list=subtractFrom_2)
byJoinedSurfaces_7 = PolySurface.ByJoinedSurfaces(surfaces=flatten_3)
watch_6 = Watch(byJoinedSurfaces_7)
integer_slider_2 = IntegerSlider(7, range=-100..30 step 1)
translate_5 = Geometry.Translate(geometry=byJoinedSurfaces_7, xTranslation=integer_slider_2)
bake_to_alias_3 = BakeNode(translate_5)
byJoinedSurfaces_8 = PolySurface.ByJoinedSurfaces()  # unwired: surfaces
byJoinedSurfaces_9 = Solid.ByJoinedSurfaces(facesOfSolid=byJoinedSurfaces_8)
edges = Topology.Edges(topology=byJoinedSurfaces_9)
XAxis_3 = Vector.XAxis()
projectInputOnto_5 = Surface.ProjectInputOnto(surface=byJoinedSurfaces_6, projectionDirection=XAxis_3)  # unwired: geometryToProject
boolean_6 = BoolSelector(false)
clean_4 = List.Clean(list=projectInputOnto_5, preserveIndices=boolean_6)
code_block_30 = CodeBlock { 0.1; }
byJoinedCurves_8 = PolyCurve.ByJoinedCurves(curves=clean_4, joinTolerance=code_block_30)
byPatch = Surface.ByPatch(closedCurve=byJoinedCurves_8)
ꟿ_closedcurve_offset_2 = Custom[ꟿ ClosedCurve.Offset+]()  # unwired: curve, distance
perimeterCurves_3 = Surface.PerimeterCurves(surface=byJoinedSurfaces_7)
origin_2 = Point.Origin()
byCoordinates_2 = Point.ByCoordinates(x=integer_slider_2)
byTwoPoints_2 = Vector.ByTwoPoints(start=origin_2, end=byCoordinates_2)
extrude_2 = Curve.Extrude(curve=perimeterCurves_3, direction=byTwoPoints_2)
byJoinedSurfaces_10 = PolySurface.ByJoinedSurfaces(surfaces=extrude_2)
bake_to_alias_4 = BakeNode(byJoinedSurfaces_10)
list_create_5 = List.Create(item0=byJoinedSurfaces_7, item1=byJoinedSurfaces_10, item2=translate_5)
surfaces = PolySurface.Surfaces(polySurface=list_create_5)
bake_to_alias_5 = BakeNode(surfaces)
