# Dynamo graph hole_distribute_11_test.dyn (Dynamo 2.0.1.6255)

select_from_alias = SelectNode()

# group: Controls
hole_diameter = DoubleSlider(3.9, range=1..15 step 0.1)
number_of_rows = IntegerSlider(2, range=1..8 step 1)
number_of_holes_per_row = IntegerSlider(19, range=8..70 step 1)

# group: Cylinder Generator
code_block = CodeBlock { -2; }
byOrigin = CoordinateSystem.ByOrigin(z=code_block)
code_block_2 = CodeBlock(x=hole_diameter) { x/2; }
code_block_3 = CodeBlock { 5; }
byRadiusHeight = Cylinder.ByRadiusHeight(cs=byOrigin, radius=code_block_2, height=code_block_3)

# group: Input
select_from_alias_2 = SelectNode()

uv_direction = IntegerSlider(0, range=0..1 step 1)

# group: Isocurve Generator
code_block_4 = CodeBlock(x=number_of_rows) { lst = (0..1..#(x+2)); lst_cut = List.Slice(lst,1,-1); }
byIsoCurveOnSurface = Curve.ByIsoCurveOnSurface(baseSurface=select_from_alias_2, direction=uv_direction, parameter=code_block_4.lst_cut, lacing=CrossProduct)
transpose = List.Transpose(lists=byIsoCurveOnSurface)
byJoinedCurves = PolyCurve.ByJoinedCurves(curves=transpose)
code_block_5 = CodeBlock(x=number_of_holes_per_row) { (0..1..#x); }
pointAtParameter = Curve.PointAtParameter(curve=byJoinedCurves, param=code_block_5, lacing=CrossProduct)

# group: CS at CrvPt on Srf
flatten = List.Flatten(list=pointAtParameter, lacing=Shortest)
distanceTo = Geometry.DistanceTo(geometry=flatten@L1, other=select_from_alias_2, lacing=CrossProduct)
flatten_2 = List.Flatten(list=distanceTo, lacing=Longest)
minimumItem = List.MinimumItem(list=flatten_2, lacing=Shortest)
indexOf = List.IndexOf(list=flatten_2@L2, element=minimumItem, lacing=Longest)
getItemAtIndex = List.GetItemAtIndex(list=select_from_alias_2, index=indexOf)
UVParameterAtPoint = Surface.UVParameterAtPoint(surface=getItemAtIndex@L1, point=flatten@L1, lacing=Shortest)
U = UV.U(uV=UVParameterAtPoint)
V = UV.V(uV=UVParameterAtPoint)
coordinateSystemAtParameter = Surface.CoordinateSystemAtParameter(surface=getItemAtIndex, u=U, v=V)

SURFACES = Watch(select_from_alias_2)
inside_outside = IntegerSlider(1, range=-1..1 step 2)

# group: PLACE AND TRIM CYLINDERS
transform = Geometry.Transform(geometry=byRadiusHeight, cs=coordinateSystemAtParameter, lacing=CrossProduct)
byUnion = Solid.ByUnion(solids=transform)
bySolid = PolySurface.BySolid(solid=transform)
surfaces = PolySurface.Surfaces(polySurface=bySolid)
byJoinedSurfaces = PolySurface.ByJoinedSurfaces(surfaces=SURFACES)
code_block_6 = CodeBlock(x=inside_outside) { x*4; false; }
thicken = Surface.Thicken(surface=byJoinedSurfaces, thickness=code_block_6.out0, both_sides=code_block_6.out1)
subtractFrom = Surface.SubtractFrom(surface=surfaces, trimmingEntity=thicken)

# group: TRIM SURFACES
subtractFrom_2 = Surface.SubtractFrom(surface=select_from_alias, trimmingEntity=byUnion, lacing=CrossProduct)

# group: CLEAN OUTPUT
clean = List.Clean(list=subtractFrom@L1)
list_create = List.Create(item0=subtractFrom_2, item1=clean)
flatten_3 = List.Flatten(list=list_create)

code_block_7 = CodeBlock { -200; }
translate = Geometry.Translate(geometry=flatten_3, xTranslation=code_block_7)
bake_to_alias = BakeNode(translate)
