# Dynamo graph shutline_generator.DYN "shutline_generator.DYN" (Dynamo 2.0.1.6255)

ZAxis = Vector.ZAxis()
select_from_alias = SelectNode()
select_from_alias_2 = SelectNode()
YAxis = Vector.YAxis()
projectInputOnto = Surface.ProjectInputOnto(surface=select_from_alias, geometryToProject=select_from_alias_2, projectionDirection=YAxis, lacing=CrossProduct)
flatten = List.Flatten(list=projectInputOnto)
code_block = CodeBlock { "NurbsCurve"; }
removeIfNot = List.RemoveIfNot(list=flatten, type=code_block)
planeAtParameter = Curve.PlaneAtParameter(curve=removeIfNot)
number_slider = DoubleSlider(3, range=0..10 step 0.1)
code_block_2 = CodeBlock(x=number_slider) { x/2; }
byPlaneRadius = Circle.ByPlaneRadius(plane=planeAtParameter, radius=code_block_2)
bySweep = Solid.BySweep(profile=byPlaneRadius, path=removeIfNot)
bake_to_alias = BakeNode(bySweep)
XAxis = Vector.XAxis()
reverse = Vector.Reverse(vector=XAxis)
