# Dynamo graph shutline_generator_test.DYN "shutline_generator_test.DYN" (Dynamo 2.0.1.6255)

surfaces_to_project_on = SelectNode()
watch = Watch(surfaces_to_project_on)
projection_curves = SelectNode()
watch_2 = Watch(projection_curves)

# group: CLEAN INPUT SURFS
code_block = CodeBlock { "NurbsSurface"; }
removeIfNot = List.RemoveIfNot(list=surfaces_to_project_on, type=code_block)
code_block_2 = CodeBlock { "Surface"; }
removeIfNot_2 = List.RemoveIfNot(list=surfaces_to_project_on, type=code_block_2)
join = List.Join(list0=removeIfNot, list1=removeIfNot_2)

# group: DETERMINE VECTOR PER CURVE
byJoinedSurfaces = PolySurface.ByJoinedSurfaces(surfaces=join)
byGeometry = BoundingBox.ByGeometry(geom=byJoinedSurfaces)
toPolySurface = BoundingBox.ToPolySurface(boundingBox=byGeometry)
surfaces = PolySurface.Surfaces(polySurface=toPolySurface)
watch_3 = Watch(projection_curves)
distanceTo = Geometry.DistanceTo(geometry=watch_3@L1, other=surfaces, lacing=CrossProduct)
flatten = List.Flatten(list=distanceTo, lacing=Shortest)
minimumItem = List.MinimumItem(list=flatten@L2, lacing=Shortest)
indexOf = List.IndexOf(list=flatten@L2, element=minimumItem, lacing=Longest)
getItemAtIndex = List.GetItemAtIndex(list=surfaces, index=indexOf)
code_block_3 = CodeBlock { 0.5; }
pointAtParameter = Surface.PointAtParameter(surface=getItemAtIndex, u=code_block_3, v=code_block_3)
normalAtPoint = Surface.NormalAtPoint(surface=getItemAtIndex, point=pointAtParameter)

projectInputOnto = Surface.ProjectInputOnto(surface=watch, geometryToProject=watch_2, projectionDirection=normalAtPoint@L1, lacing=CrossProduct)  # frozen
flatten_2 = List.Flatten(list=projectInputOnto)
code_block_4 = CodeBlock { "NurbsCurve"; }
removeIfNot_3 = List.RemoveIfNot(list=flatten_2, type=code_block_4)
planeAtParameter = Curve.PlaneAtParameter(curve=removeIfNot_3)
shutline_diameter = DoubleSlider(1, range=0..10 step 0.1)
code_block_5 = CodeBlock(x=shutline_diameter) { x/2; }
byPlaneRadius = Circle.ByPlaneRadius(plane=planeAtParameter, radius=code_block_5)
bySweep = Solid.BySweep(profile=byPlaneRadius, path=removeIfNot_3)
bake_to_alias = BakeNode(bySweep)  # frozen
pointAtParameter_2 = Curve.PointAtParameter(curve=projectInputOnto)
flatten_3 = List.Flatten(list=pointAtParameter_2)
code_block_6 = CodeBlock { "Point"; }
removeIfNot_4 = List.RemoveIfNot(list=flatten_3, type=code_block_6)
indexOf_2 = List.IndexOf(list=pointAtParameter_2@L1, element=removeIfNot_4, lacing=CrossProduct)
getItemAtIndex_2 = List.GetItemAtIndex(list=normalAtPoint, index=indexOf_2)
firstIndexOf = List.FirstIndexOf(list=pointAtParameter_2@L1, item=removeIfNot_4)
code_block_7 = CodeBlock { []; }
code_block_8 = CodeBlock(x=projectInputOnto) { x == null; }
replaceByCondition = Replace(item=projectInputOnto, replaceWith=code_block_7, condition=code_block_8)
code_block_9 = CodeBlock()
# ---------- code_block_9.designscript (6 lines) ----------
str = "";

[Imperative]
{
	return str.Type;
};
# ----------------------------------------
code_block_10 = CodeBlock(surfs=watch, curves=watch_2, vectors=normalAtPoint)
# ---------- code_block_10.designscript (28 lines) ----------
geo = Surface.ProjectInputOnto(surfs<1>, curves, vectors);

vectorList = [];
curveList = [];

[Imperative]
{
	//for (i in 0..geo.Count)
	for (i in 0..List.Count(geo))
	{
		for (j in 0..1)
		{
			curveList[i][j] = geo[i][j][0];
			vectorList[i][j] = geo[i][j][0];

			if (vectorList[i][j])
			{
				vectorList[i][j] = vectors[j];
			}



		}
	}

	return [vectorList, curveList];

};
# ----------------------------------------
code_block_11 = CodeBlock(i=code_block_10.out3) { i[1]; }
watch_4 = Watch(code_block_11)
code_block_12 = CodeBlock { "test"; }
type = Object.Type(obj=code_block_12)
code_block_13 = CodeBlock { str2 = DSCore.Object.Type("test"); str2.Type; }
code_block_14 = CodeBlock { vector1 = Vector.YAxis(); vector2 = Vector.XAxis(); vector3 = Vector.Add(vector1, vector2); }
